% Simulink data dictionary neck_mk3.sldd

MCU_Ts = 0.001

Data_ControlCommands = Simulink.Bus()
  Voltage: single[3], Min=-100, Max=100, Unit="%"  % Actuation voltage signals.

Data_ControlFeedback = Simulink.Bus()
  Encoders: single[3], Unit="deg"

Data_JointReferences = Simulink.Bus()
  SetPoints: single[3], Unit="deg"  % Setpoints that the system needs to track.

Data_Measurements = Simulink.Bus()
  Encoders: single[3], Unit="deg"

Physical_MotorRotationals = Simulink.ConnectionBus()
  Motor1: Connection: foundation.mechanical.rotational.rotational
  Motor2: Connection: foundation.mechanical.rotational.rotational
  Motor3: Connection: foundation.mechanical.rotational.rotational
  Reference: Connection: foundation.mechanical.rotational.rotational

Physical_JointRotationals = Simulink.ConnectionBus()
  Joint1_Stage1: Connection: foundation.mechanical.rotational.rotational
  Joint1_Stage2: Connection: foundation.mechanical.rotational.rotational
  Joint2_Stage1: Connection: foundation.mechanical.rotational.rotational
  Joint2_Stage2: Connection: foundation.mechanical.rotational.rotational
  Joint3_Stage1: Connection: foundation.mechanical.rotational.rotational
  Joint3_Stage2: Connection: foundation.mechanical.rotational.rotational
  Reference: Connection: foundation.mechanical.rotational.rotational

Physical_MotorPhases = Simulink.ConnectionBus()
  Phase1_Pos: Connection: foundation.electrical.electrical
  Phase2_Pos: Connection: foundation.electrical.electrical
  Phase3_Pos: Connection: foundation.electrical.electrical
  Phase_Neg: Connection: foundation.electrical.electrical

Physical_Environment = Simulink.ConnectionBus()
  World: Connection: simmechanics.connections.frame

Physical_JointMultibody = Simulink.ConnectionBus()
  Joint1_B: Connection: simmechanics.connections.frame
  Joint1_F: Connection: simmechanics.connections.frame
  Joint2_B: Connection: simmechanics.connections.frame
  Joint2_F: Connection: simmechanics.connections.frame
  Joint3_B: Connection: simmechanics.connections.frame
  Joint3_F: Connection: simmechanics.connections.frame