% Simulink data dictionary neck_mk3_serial_data.sldd

mk3_serial_smiData = struct(
  RigidTransform=[struct(translation=[0 0 0], angle=0, axis=[0 0 0], ID="B[1110:-:1442]"), struct(translation=[0.6 -7.105427e-15 -3.552714e-15], angle=3.141593, axis=[-1 0 0], ID="F[1110:-:1442]"), struct(translation=[0 0 0], angle=0, axis=[0 0 0], ID="B[1863:-:3310]"), struct(
    translation=[0 1.776357e-15 -6.5],
    angle=1.570796,
    axis=[7.850462e-17 7.850462e-17 -1],
    ID="F[1863:-:3310]"), struct(translation=[0 0 0], angle=0, axis=[0 0 0], ID="B[1865:-:3399]"), struct(translation=[0 8.881784e-16 -4.5], angle=4.551914e-15, axis=[-0 -8.665155e-17 1], ID="F[1865:-:3399]"), struct(translation=[0 0 0], angle=0, axis=[0 0 0], ID="B[2189:-:2190]"), struct(
    translation=[-5.176381 19.31852 16.15],
    angle=1.308997,
    axis=[-9.118704e-17 9.118704e-17 -1],
    ID="F[2189:-:2190]"), struct(translation=[0 0 0], angle=0, axis=[0 0 0], ID="B[2189:-:2966]"), struct(
    translation=[-8.570115 -27.18093 16.15],
    angle=1.308997,
    axis=[-9.118704e-17 9.118704e-17 -1],
    ID="F[2189:-:2966]"), struct(translation=[0 0 0], angle=0, axis=[0 0 0], ID="B[2189:-:2967]"), struct(
    translation=[21.0124 -19.25432 16.15],
    angle=1.308997,
    axis=[-9.118704e-17 9.118704e-17 -1],
    ID="F[2189:-:2967]"), struct(translation=[0 0 0], angle=0, axis=[0 0 0], ID="B[3310:-:3503]"), struct(translation=[8.437693e-15 -10.25 -2.1], angle=3.141593, axis=[0 2.220446e-16 -1], ID="F[3310:-:3503]"), struct(translation=[0 0 0], angle=0, axis=[0 0 0], ID="B[3310:-:3545]"), struct(
    translation=[1.065814e-14 -10.25 -2.1],
    angle=1.570796,
    axis=[-7.850462e-17 -7.850462e-17 1],
    ID="F[3310:-:3545]"), struct(translation=[0 0 0], angle=0, axis=[0 0 0], ID="B[3310:-:3546]"), struct(translation=[8.881786e-15 -10.25 -2.1], angle=0, axis=[0 0 0], ID="F[3310:-:3546]"), struct(translation=[0 0 0], angle=0, axis=[0 0 0], ID="B[3310:-:3547]"), struct(
    translation=[7.105427e-15 -10.25 -2.1],
    angle=1.570796,
    axis=[-7.850462e-17 7.850462e-17 -1],
    ID="F[3310:-:3547]"), struct(translation=[0 0 0], angle=0, axis=[0 0 0], ID="B[3399:-:3454]"), struct(translation=[0 1.110223e-16 -0.5], angle=3.141593, axis=[0 2.220446e-16 -1], ID="F[3399:-:3454]"), struct(translation=[0 0 0], angle=0, axis=[0 0 0], ID="B[78:-:1863]"), struct(translation=[0 0 -32], angle=2.094395, axis=[0.5773503 0.5773503 0.5773503], ID="F[78:-:1863]"), struct(translation=[0 0 0], angle=0, axis=[0 0 0], ID="B[78:-:2189]"), struct(translation=[0 0 -8.65], angle=1.950441, axis=[0.6776615 0.5199879 0.5199879], ID="F[78:-:2189]"), struct(translation=[0 0 0], angle=0, axis=[0 0 0], ID="B[78:-:427]"), struct(translation=[0.5 -1.110223e-16 0], angle=3.141593, axis=[-0.7071068 0.7071068 0], ID="F[78:-:427]"), struct(translation=[0 -12 0], angle=2.094395, axis=[-0.5773503 -0.5773503 -0.5773503], ID="B[78:-:428]"), struct(
    translation=[17 3.552714e-15 0],
    angle=2.094395,
    axis=[0.5773503 0.5773503 0.5773503],
    ID="F[78:-:428]"), struct(translation=[0 0 0], angle=0, axis=[0 0 0], ID="B[106:-:1110]"), struct(translation=[-8.5 0 9.5], angle=3.141593, axis=[1 0 0], ID="F[106:-:1110]"), struct(translation=[21 0 9.5], angle=2.094395, axis=[0.5773503 0.5773503 0.5773503], ID="B[106:-:1631]"), struct(
    translation=[17 0 1.065814e-14],
    angle=2.094395,
    axis=[-0.5773503 -0.5773503 0.5773503],
    ID="F[106:-:1631]"), struct(translation=[0 0 0], angle=0, axis=[0 0 0], ID="B[106:-:1865]"), struct(
    translation=[1.262177e-29 0 -33],
    angle=1.570796,
    axis=[1 -2.275957e-15 -2.275957e-15],
    ID="F[106:-:1865]"), struct(translation=[0 0 0], angle=0, axis=[0 0 0], ID="B[106:-:2970]"), struct(
    translation=[-1.009742e-28 5.684342e-14 -32.5],
    angle=1.570796,
    axis=[-1 -1.804112e-15 1.804112e-15],
    ID="F[106:-:2970]"), struct(translation=[0 0 0], angle=0, axis=[0 0 0], ID="B[106:-:3585]"), struct(translation=[-9.5 0 23], angle=3.141593, axis=[0.7071068 0 0.7071068], ID="F[106:-:3585]")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],
  Solid=[struct(
    mass=0.03941892,
    CoM=[-5.435202 -3.450705 -33.36618],
    MoI=[22.37494 18.76501 11.90699],
    PoI=[3.403257 -2.014176 0.4656572],
    color=[0.5 0.5 0.5],
    opacity=1,
    ID="HESN0001_prt"), struct(
    mass=0.01191153,
    CoM=[14.74635 0 0],
    MoI=[1.956883 0.9861832 1.010202],
    PoI=[-0.01200987 0 0],
    color=[0.5 0.5 0.5],
    opacity=1,
    ID="HFUC-8-100-2A-R_A_prt"), struct(
    mass=0.005478113,
    CoM=[-2.092894 -0.2028285 -3.829399],
    MoI=[0.624961 1.574425 1.68285],
    PoI=[-0.006977942 -0.1700975 0.03193563],
    color=[0.5 0.5 0.5],
    opacity=1,
    ID="HESN0006_prt"), struct(
    mass=0.06530244,
    CoM=[0.006448462 -1.225192 -8.109008],
    MoI=[6.828945 5.612554 9.173537],
    PoI=[0.1443498 0.001963736 0.007603493],
    color=[0.5 0.5 0.5],
    opacity=1,
    ID="3216W_BXTH_prt"), struct(
    mass=0.0002260105,
    CoM=[0 0 -0.4662976],
    MoI=[0.0006828573 0.0006828577 0.0003035176],
    PoI=[0 0 0],
    color=[0.5 0.5 0.5],
    opacity=1,
    ID="M2X04-6LOBE-ISO14583-A2-70_prt"), struct(
    mass=0.0009609497,
    CoM=[11.25189 -0.01128365 -0.01128362],
    MoI=[0.006251684 0.0325472 0.0325472],
    PoI=[4.399283e-07 -0.0001003182 -0.0001003184],
    color=[0.5 0.5 0.5],
    opacity=1,
    ID="HESN0007_prt"), struct(
    mass=0.01179477,
    CoM=[15.34586 -0.002140098 0.002243917],
    MoI=[0.3899513 0.2718532 0.2718551],
    PoI=[0 0.0001484174 -0.0001479631],
    color=[0.5 0.5 0.5],
    opacity=1,
    ID="HFUC-8-100-2A-R_B_prt"), struct(
    mass=0.0004886885,
    CoM=[0 0 -0.9235961],
    MoI=[0.003017081 0.003017083 0.0009927027],
    PoI=[0 0 0],
    color=[0.5 0.5 0.5],
    opacity=1,
    ID="M2_5X06-6LOBE-ISO14583-A2-70_prt"), struct(
    mass=0.004467658,
    CoM=[6.753466 0 0],
    MoI=[0.3012443 0.2896632 0.2941252],
    PoI=[0 0 0],
    color=[0.5 0.5 0.5],
    opacity=1,
    ID="HFUC-8-100-2A-R_C_prt"), struct(
    mass=0.03414167,
    CoM=[-0.4697355 0.3789373 10.12143],
    MoI=[19.69746 12.45229 28.02294],
    PoI=[-0.05864606 0.07661262 0.00656605],
    color=[0.5 0.5 0.5],
    opacity=1,
    ID="HESN0002_prt"), struct(
    mass=0.003,
    CoM=[0 0 2],
    MoI=[0.07313135 0.07313134 0.1396285],
    PoI=[0 0 0],
    color=[0.5 0.5 0.5],
    opacity=1,
    ID="618-9_prt"), struct(
    mass=0.01459282,
    CoM=[-19.9708 0 -0.4435436],
    MoI=[0.7759094 4.697246 5.046462],
    PoI=[0 -0.8230074 0],
    color=[0.5 0.5 0.5],
    opacity=1,
    ID="HESN0005_prt"), struct(
    mass=0.0002769967,
    CoM=[0 0 0],
    MoI=[0.002836158 0.002836157 0.005626148],
    PoI=[0 0 0],
    color=[0.5 0.5 0.5],
    opacity=1,
    ID="4_3X12X1-ISO7093-A2_prt"), struct(
    mass=0.003589218,
    CoM=[0 0 1.905808],
    MoI=[0.1745888 0.1745888 0.3320736],
    PoI=[0 0 0],
    color=[0.5 0.5 0.5],
    opacity=1,
    ID="HESN0008_prt"), struct(
    mass=0.001357047,
    CoM=[0 0 -0.4588795],
    MoI=[0.01153201 0.01153202 0.006137602],
    PoI=[0 0 0],
    color=[0.5 0.5 0.5],
    opacity=1,
    ID="M4X06-6LOBE-ISO14580-A2-70_prt"), struct(
    mass=0.0001842677,
    CoM=[0 0 -2.449782],
    MoI=[0.0007082392 0.0007082393 0.0001631878],
    PoI=[0 0 0],
    color=[0.5 0.5 0.5],
    opacity=1,
    ID="M2X06-6LOBE-ISO14581-A2-70_prt"), struct(
    mass=0.0266426,
    CoM=[-0.6879975 0 27.91387],
    MoI=[8.415337 28.23364 20.91909],
    PoI=[0 -0.177937 0],
    color=[0.5 0.5 0.5],
    opacity=1,
    ID="HESN0003_prt"), struct(
    mass=0.009979792,
    CoM=[-0.5624226 0 11.52291],
    MoI=[0.5750202 0.540993 0.2713146],
    PoI=[0 -0.001251225 0],
    color=[0.5 0.5 0.5],
    opacity=1,
    ID="HESN0004_prt")],
  RevoluteJoint=[struct(Rz=struct(Pos=90), ID="[78:-:428]"), struct(Rz=struct(Pos=180), ID="[106:-:1631]"), struct(Rz=struct(Pos=0), ID="[229:-:407]")])