# Requirement set neck_functional_requirements (R2023b)

## 1 [NeckFR_1] Sensing (Container)

### 1.1 [NeckFR_2] Disambiguate kinematic configurations from sensor readings
We shall be always able to reconstruct the kinematic configuration of the mechanism univocally.
This means that the sensors shall be mounted on the structure accordingly to provide suitable readings that help to disambiguate any possible configuration.
Rationale: An example that we aim to prevent from striking and disrupting our efforts.
- We use an absolute sensing system (e.g., AEA sensors)
- However, the sensors may be subject to multiturns behaviors.
- As a result, we lose the possibility to disambiguate kinematic configurations from the sensor readings.

### 1.2 [NeckFR_5] Vision Accuracy
The absolute sensing must guarantee high accuracy of 3D reconstruction of the world through the vision system.
In particular, any possible impairment (e.g., backlash) must be measured and thus taken into account by the high-level vision algorithms.

## 2 [NeckFR_3] Kinematics (Container)

### 2.1 [NeckFR_4] Gazing for Grasping on a table
The neck shall guarantee the functionalities required by a successful grasping action.
For verification purposes, one can refer to https://github.com/robotology/icub-gazebo-grasping-sandbox.