% Requirement links of neck_functional_requirements.slreqx (R2024a)

#7 relates to neck_mk3.sldd: Design.Req_DOF_Bounds
#7 relates to neck_mk3.sldd: Design.Req_Control_SettlingTime
#9 relates to neck_mk3.sldd: Design.Req_Velocity_Peak
#9 relates to neck_mk3.sldd: Design.Req_Velocity_Avg