test file "test_req"

suite "Test Neck Mk2"

  case "Test Range of Motion (ROM)" [simulation]
    model arch_logical, harness arch_logical_Harness_ReqTest_FR_7
    parameter set "ergoCub Payload": TestVariantConfiguration = "Variant_NeckMk2_ergoCub"  % model workspace
    parameter set "iCub Payload" (off): TestVariantConfiguration = "Variant_NeckMk2_iCub"  % model workspace
    post-load callback:
      sltest.harness.open(sltest_sut, sltest_bdroot);

  case "Test Home Configuration Alignment" [simulation]
    model arch_logical, harness arch_logical_Harness_ReqTest_FR_19
    parameter set "Parameter Set 1": TestVariantConfiguration = "Variant_NeckMk2_ergoCub"  % model workspace
    parameter set "Parameter Set 2" (off): TestVariantConfiguration = "Variant_NeckMk2_iCub"  % model workspace
    post-load callback:
      sltest.harness.open(sltest_sut, sltest_bdroot);

  case "Test High Performance" [simulation]
    model arch_logical, harness arch_logical_Harness_ReqTest_HighPerformance
    parameter set "Parameter Set 1":
      TestVariantConfiguration = "Variant_NeckMk2_ergoCub"  % model workspace
      Param_Planner_MinJerk_ReactionTime = 0.3  % neck_mk3.sldd
      Req_Control_SettlingTime = 0.8  % neck_mk3.sldd
      Req_Velocity_Peak = [160;100;200]  % neck_mk3.sldd
      Req_Caps_Motor_Currents = [1.4; 1.4; 1.4]  % neck_mk3.sldd
      Req_Caps_Motor_Torques = [16; 16; 16]  % neck_mk3.sldd
      Req_Caps_Motor_Velocity = [7000; 7000; 7000]  % neck_mk3.sldd
      Req_Caps_Transmission_Torques = [2.4; 2.4; 2.4]  % neck_mk3.sldd
      Req_Caps_Transmission_Velocity = [85; 85; 85]  % neck_mk3.sldd
    parameter set "Parameter Set 2" (off):
      Param_Planner_MinJerk_ReactionTime = 0.3  % neck_mk3.sldd
      TestVariantConfiguration = "Variant_NeckMk2_iCub"  % model workspace
      Req_Control_SettlingTime = 0.8  % neck_mk3.sldd
      Req_Velocity_Peak = [160;100;200]  % neck_mk3.sldd
      Req_Caps_Motor_Currents = [1.4; 1.4; 1.4]  % neck_mk3.sldd
      Req_Caps_Motor_Torques = [16; 16; 16]  % neck_mk3.sldd
      Req_Caps_Motor_Velocity = [7000; 7000; 7000]  % neck_mk3.sldd
      Req_Caps_Transmission_Torques = [2.4; 2.4; 2.4]  % neck_mk3.sldd
      Req_Caps_Transmission_Velocity = [85; 85; 85]  % neck_mk3.sldd
    post-load callback:
      sltest.harness.open(sltest_sut, sltest_bdroot);

suite "Test Neck Mk3 Serial"

  case "Test Range of Motion (ROM)" [simulation]
    model arch_logical, harness arch_logical_Harness_ReqTest_FR_7
    parameter set "ergoCub Payload": TestVariantConfiguration = "Variant_NeckMk3_Serial_ergoCub"  % model workspace
    parameter set "iCub Payload" (off): TestVariantConfiguration = "Variant_NeckMk3_Serial_iCub"  % model workspace
    post-load callback:
      sltest.harness.open(sltest_sut, sltest_bdroot);

  case "Test Home Configuration Alignment" [simulation]
    model arch_logical, harness arch_logical_Harness_ReqTest_FR_19
    parameter set "Parameter Set 1": TestVariantConfiguration = "Variant_NeckMk3_Serial_ergoCub"  % model workspace
    parameter set "Parameter Set 2" (off): TestVariantConfiguration = "Variant_NeckMk3_Serial_iCub"  % model workspace
    post-load callback:
      sltest.harness.open(sltest_sut, sltest_bdroot);

  case "Test High Performance" [simulation]
    model arch_logical, harness arch_logical_Harness_ReqTest_HighPerformance
    parameter set "Parameter Set 1":
      TestVariantConfiguration = "Variant_NeckMk3_Serial_ergoCub"  % model workspace
      Param_Planner_MinJerk_ReactionTime = 0.3  % neck_mk3.sldd
      Req_Control_SettlingTime = 0.8  % neck_mk3.sldd
      Req_Velocity_Peak = [160;160;200]  % neck_mk3.sldd
      Req_Caps_Motor_Currents = [1.1; 1.1; 0.36]  % neck_mk3.sldd
      Req_Caps_Motor_Torques = [38; 38; 9.7]  % neck_mk3.sldd
      Req_Caps_Motor_Velocity = [4320; 4320; 2710]  % neck_mk3.sldd
      Req_Caps_Transmission_Torques = [2.4; 2.4; 2.4]  % neck_mk3.sldd
      Req_Caps_Transmission_Velocity = [85; 85; 85]  % neck_mk3.sldd
    parameter set "Parameter Set 2" (off):
      Param_Planner_MinJerk_ReactionTime = 0.3  % neck_mk3.sldd
      TestVariantConfiguration = "Variant_NeckMk3_Serial_iCub"  % model workspace
      Req_Control_SettlingTime = 0.8  % neck_mk3.sldd
      Req_Velocity_Peak = [160;160;200]  % neck_mk3.sldd
      Req_Caps_Motor_Currents = [1.1; 1.1; 0.36]  % neck_mk3.sldd
      Req_Caps_Motor_Torques = [38; 38; 9.7]  % neck_mk3.sldd
      Req_Caps_Motor_Velocity = [4320; 4320; 2710]  % neck_mk3.sldd
      Req_Caps_Transmission_Torques = [2.4; 2.4; 2.4]  % neck_mk3.sldd
      Req_Caps_Transmission_Velocity = [85; 85; 85]  % neck_mk3.sldd
    post-load callback:
      sltest.harness.open(sltest_sut, sltest_bdroot);